# Grasshopper definition vizualize_pnts.ghx (Grasshopper 1.0.7)

panel = Panel("/Users/edvard/Documents/github/rob_fab_reach/_data")
# 139,308 is the total number of points
# for R1 work volume at 0.1m spacing
# x: -1.5 --> 6.0
# y: 0.3 --> 4.9
# z: -0.4 --> 3.4
# 
# 139,308 is the total number of points
# for R2 work volume at 0.1m spacing
# x: -1.5 --> 6.0
# y: -1.5 --> 3.1
# z: -0.4 --> 3.4
# 
# 162,240 is the total number of points
# for R3 work volume at 0.1m spacing
# x: 1.7 --> 8.0
# y: -1.5 --> 4.9
# z: -0.4 --> 3.4
# 
# 243,360 is the total number of points
# for 3 robot work volume at 0.1m spacing
# x: -1.5 --> 8.0
# y: -1.5 --> 4.9
# z: -0.4 --> 3.4
panel_2 = Panel("{}/{}_vec{:0>2}_combo.json")
number_slider = Slider(100, range=1..100)
list = ValueList({"Robot 1": "rob1", "Robot 2": "rob2", "Robot 3": "rob3", "Robot 1&2": "rob1,rob2", "Robot 1&3": "rob1,rob3", "Robot 2&3": "rob2,rob3", "Robot 1&2&3": "rob1,rob2,rob3"}, selected="Robot 1&2&3")

# ----
# 'n' robots reach
# (0 and 1, equivalent to No/Yes)
# (2 and 3, if you are reading in data for 2 or 3 robs)
number_slider_2 = Slider(3, range=0..3)
# single direction reachability
data = Data(panel)
data_2 = Data(panel_2)
data_3 = Data(list)
data_4 = Data(Slider(50, range=1..100))
python = GhPythonScript(path=data, name=data_2, rob_num=data_3, step_num=data_4, read_data=Toggle(False))  # -> points, values, vector; inputs step_num: Int32
# ---------- python: Python ----------
import os
import json
from compas_fab.utilities import read_data_from_json
from compas_fab.robots import Configuration


def initialize_count(rob_num):
    
    point_count = {}
    
    for rob in rob_num:
        print rob
        filename = name.format(rob,rob,1) # just take first to init
        filepath = os.path.join(path, filename)
        
        print filepath
        
        with open(filepath, "r") as f:
            file_data = f.read()
            
        f.close()
        
        data = json.loads(file_data)
        point_count.update(data['results'])
        
        print len(point_count)
        
    for key in point_count:
        point_count[key] = 0
    
    return point_count


if read_data:
    
    rob_num = rob_num.split(",")
    point_count = initialize_count(rob_num)
    
    for rob in rob_num:
        print "read", rob
        filename = name.format(rob,rob,step_num)
        filepath = os.path.join(path, filename)
    
        with open(filepath, "r") as f:
            file_data = f.read()
            data = json.loads(file_data)
            f.close()
        
        for pnt,result in data['results'].items():
            if result:
                point_count[pnt] += 1
                    
    vector = data['vector']
    points = point_count.keys()
    values = point_count.values()
# ---------- end python ----------

data_5 = Data(panel_2)

# ----
# cumulative reachability
data_6 = Data(panel)
data_7 = Data(list)
data_8 = Data(number_slider)
python_2 = GhPythonScript(path=data_6, name=data_5, rob_num=data_7, step_num=data_8, read_data=Toggle(False))  # -> points, values, co_cnt_val, simplify(vectors); inputs step_num: Int32
# ---------- python_2: Python ----------
import os
import json
from compas_fab.utilities import read_data_from_json
from compas_fab.robots import Configuration

import ghpythonlib.treehelpers as th

"""


243,360 is the total number of points
for 3 robot work volume at 0.1m spacing
x: -1.5 --> 8.0
y: -1.5 --> 4.9
z: -0.4 --> 3.4
"""

def initialize_count(rob_num):
    
    point_count = {}
    
    for rob in rob_num:
        filename = name.format(rob,rob,1) # just take first to init
        filepath = os.path.join(path, filename)
        
        #print rob,filepath
        
        with open(filepath, "r") as f:
            file_data = f.read()
            
        f.close()
        
        data = json.loads(file_data)
        point_count.update(data['results'])
        
        print len(point_count)
        
    for key in point_count:
        point_count[key] = 0
    
    return point_count

    

if read_data:
    
    rob_num = rob_num.split(",")
    
    point_count = initialize_count(rob_num)
    cooperative_count_save = initialize_count(rob_num)
    vectors = []
    
        
    for i in range(1,step_num+1):
        
        cooperative_count = initialize_count(rob_num)

        for rob in rob_num:
            print "{}: vector {}".format(rob,i)
            
            filename = name.format(rob,rob,i)
            filepath = os.path.join(path, filename)
            
            with open(filepath, "r") as f:
                file_data = f.read()
                data = json.loads(file_data)
                f.close()
                
                vec = data['vector']
                vectors.append(vec)
            
            for pnt,result in data['results'].items():
                if result:
                    cooperative_count[pnt] += 1
                    point_count[pnt] += 1
                    
        
        for pnt,result in cooperative_count.items():
            if result == len(rob_num):
                cooperative_count_save[pnt] = 1
            
        
    vectors = th.list_to_tree(vectors, source=[0,0])
    points = point_count.keys()
    values = point_count.values()
    
    co_cnt_val = cooperative_count_save.values()

    print points
# ---------- end python_2 ----------
pt = Point(python_2.points)
int = Integer(python_2.values)
int_2 = Integer(python_2.co_cnt_val)
num = Number(python_2.vectors)

int_3 = Integer(int)
data_9 = Data(number_slider)
data_10 = Data(list)
values = GhPythonScript(rob_num=data_10, values=int_3, n_steps=data_9)  # -> max_index, max_counts, counts; inputs values: list, n_steps: Int32
# ---------- values: Python ----------
counts = []

rob_num = rob_num.split(",")

max = n_steps * len(rob_num)

for i in range(0,max + 1):
    counts.append(values.count(i))

max_save = 0
for i,cnt in enumerate(counts):
    
    if cnt:
        max_index = i

max_counts = counts[max_index]
# ---------- end values ----------
panel_3 = Panel(values.counts)
panel_4 = Panel(values.max_index)
panel_5 = Panel(values.max_counts)
rec = DataRecorder(panel_5, DataLimit=-10, RecordData=False)

int_4 = Integer(number_slider_2)
mindex = MemberIndex(Set=python.values, Member=int_4)  # -> Index, Count
dispatch = Dispatch(List=python.points, DispatchPattern=python.values)  # -> ListA, ListB
item = ListItem(List=python.points, Index=mindex.Index, Wrap=True)

panel_6 = Panel(rec)

# ----
# View Reach Vector
item_2 = ListItem(List=python.vector, Index=0, Wrap=True)  # -> Item, Item1, Item2
panel_7 = Panel(python.vector)
pt_2 = ConstructPoint(XCoordinate=0, YCoordinate=-5, ZCoordinate=0)
vec = VectorXYZ(XComponent=item_2.Item, YComponent=item_2.Item1, ZComponent=item_2.Item2)  # -> Vector, Length
vdisex = VectorDisplayEx(Point=pt_2, Vector=vec.Vector, Colour=ColourSwatch(SwatchColor=RGB(252, 167, 167)), Width="8")

num_2 = Number(num)
flip = FlipMatrix(Data=num_2)
branch = TreeBranch(Tree=flip, Path="{1}", MaintainPaths=True)
branch_2 = TreeBranch(Tree=flip, Path="{2}", MaintainPaths=True)
branch_3 = TreeBranch(Tree=flip, Path="{0}", MaintainPaths=True)
pt_3 = ConstructPoint(XCoordinate=6, YCoordinate=-3, ZCoordinate=0)
vec_2 = VectorXYZ(XComponent=branch_3, YComponent=branch, ZComponent=branch_2)  # -> Vector, Length
vdisex_2 = VectorDisplayEx(Point=pt_3, Vector=vec_2.Vector, Colour=RGB(0, 0, 0), Width="1")

pt_4 = Point(pt)
panel_8 = Panel(panel_4)
int_5 = Integer(python_2.values)
gradient = Gradient(
    LowerLimit="0",
    UpperLimit=panel_8,
    Parameter=int_5,
    stops=[0: RGB(255, 255, 255), 0.1: RGB(236, 27, 60), 0.2: RGB(210, 0, 118), 0.3: RGB(103, 0, 120), 0.4: RGB(39, 72, 161), 0.5: RGB(1, 192, 229), 0.6: RGB(18, 178, 90), 0.7: RGB(79, 186, 8), 0.8: RGB(220, 237, 32), 0.9: RGB(247, 159, 20), 1: RGB(243, 57, 0)])
gradient_2 = Gradient(
    LowerLimit="0",
    UpperLimit=panel_8,
    Parameter=int_5,
    stops=[0: RGB(255, 255, 255), 0.8: RGB(255, 0, 0), 0.986: RGB(145, 0, 0), 1: RGB(0, 0, 0)])
preview = CustomPreview(Geometry=pt_4, Material=gradient)

pt_5 = Point(pt)
int_6 = Integer(int_2)
int_7 = Integer(int)
int_8 = Integer(int_2)
dispatch_2 = Dispatch(List=pt_5, DispatchPattern=int_6)  # -> ListA, ListB
dispatch_3 = Dispatch(List=int_7, DispatchPattern=int_8)  # -> ListA, ListB
panel_9 = Panel(panel_4)
gradient_3 = Gradient(
    LowerLimit="0",
    UpperLimit=panel_9,
    Parameter=dispatch_3.ListA,
    stops=[0: RGB(255, 255, 255), 0.1: RGB(236, 27, 60), 0.2: RGB(210, 0, 118), 0.3: RGB(103, 0, 120), 0.4: RGB(39, 72, 161), 0.5: RGB(1, 192, 229), 0.6: RGB(18, 178, 90), 0.7: RGB(79, 186, 8), 0.8: RGB(220, 237, 32), 0.9: RGB(247, 159, 20), 1: RGB(243, 57, 0)])
pt_6 = Point(dispatch_2.ListA)
preview_2 = CustomPreview(Geometry=pt_6, Material=gradient_3)

pt_7 = Point(pt)
int_9 = Integer(int)
int_10 = Integer("0")
mindex_2 = MemberIndex(Set=int_9, Member=int_10)  # -> Index, Count
item_3 = ListItem(List=pt_7, Index=mindex_2.Index, Wrap=True)
preview_3 = CustomPreview(Geometry=item_3, Material=ColourSwatch(SwatchColor=RGB(0, 34, 255)))

pt_8 = Point(pt)
int_11 = Integer(int)
panel_10 = Panel(panel_4)
int_12 = Integer(panel_10)
mindex_3 = MemberIndex(Set=int_11, Member=int_12)  # -> Index, Count
item_4 = ListItem(List=pt_8, Index=mindex_3.Index, Wrap=True)
preview_4 = CustomPreview(Geometry=item_4, Material=ColourSwatch(SwatchColor=RGB(0, 0, 0)))

int_13 = Integer(int)
pt_9 = Point(pt)
panel_11 = Panel(panel_4)
multiplication = Multiplication(A=panel_11, B=Slider(1, range=0..1))
larger = LargerThan(FirstNumber=int_13, SecondNumber=multiplication)  # -> LargerThan, OrEqualTo
dispatch_4 = Dispatch(List=pt_9, DispatchPattern=larger.OrEqualTo)  # -> ListA, ListB
preview_5 = CustomPreview(Geometry=dispatch_4.ListA, Material=ColourSwatch(SwatchColor=RGB(217, 80, 80)))

# ----
# YES reach
lng = ListLength(List=dispatch.ListA)
panel_12 = Panel(lng)
preview_6 = CustomPreview(Geometry=dispatch.ListA, Material=ColourSwatch(SwatchColor=RGB(0, 34, 255)))

# ----
# NO reach
lng_2 = ListLength(List=dispatch.ListB)
panel_13 = Panel(lng_2)
preview_7 = CustomPreview(Geometry=dispatch.ListB, Material=ColourSwatch(SwatchColor=RGB(0, 0, 0)))

# ----
# 'n' robot reach
lng_3 = ListLength(List=item)
panel_14 = Panel(lng_3)
preview_8 = CustomPreview(Geometry=item, Material=ColourSwatch(SwatchColor=RGB(250, 12, 12)))

# ----
# visualize volumes
# search domain, diagonal corners
# R1
panel_15 = Panel("{-1.5,4.9,-0.4}")
pt_10 = Point(panel_15)
pt_11 = Point("{6.0,0.3,3.4}")
box = Box2Pt(PointA=pt_10, PointB=pt_11, Plane=PlaneXY(0, 0, 0))
preview_9 = CustomPreview(Geometry=box, Material=ColourSwatch(SwatchColor=RGBA(255, 0, 0, 64)))

# ----
# R2
panel_16 = Panel("{-1.5,-1.5,-0.4}")
pt_12 = Point(panel_16)
pt_13 = Point("{6.0,3.1,3.4}")
box_2 = Box2Pt(PointA=pt_12, PointB=pt_13, Plane=PlaneXY(0, 0, 0))
preview_10 = CustomPreview(Geometry=box_2, Material=ColourSwatch(SwatchColor=RGBA(0, 34, 255, 64)))

# ----
# R3
panel_17 = Panel("{1.7,-1.5,-0.4}")
pt_14 = Point(panel_17)
pt_15 = Point("{8.0,4.9,3.4}")
box_3 = Box2Pt(PointA=pt_14, PointB=pt_15, Plane=PlaneXY(0, 0, 0))
preview_11 = CustomPreview(Geometry=box_3, Material=ColourSwatch(SwatchColor=RGBA(255, 255, 0, 64)))

panel_18 = Panel("collision mesh (ground)")
pt_16 = Point("{7,6,-0.375}")
pt_17 = Point("{-3,-3,-0.4}")
box_4 = Box2Pt(PointA=pt_17, PointB=pt_16, Plane=PlaneXY(0, 0, 0))

sint = SolidIntersection(BrepsA=box_2, BrepsB=box)
sdiff = SolidDifference(BrepsA=box_2, BrepsB=box)
sdiff_2 = SolidDifference(BrepsA=box, BrepsB=box_2)
sint_2 = SolidIntersection(BrepsA=sint, BrepsB=box_3)
sdiff_3 = SolidDifference(BrepsA=sint, BrepsB=box_3)
preview_12 = CustomPreview(Geometry=sint_2, Material=ColourSwatch(SwatchColor=RGBA(255, 0, 0, 64)))
preview_13 = CustomPreview(Geometry=sdiff_3, Material=ColourSwatch(SwatchColor=RGBA(255, 255, 0, 64)))
preview_14 = CustomPreview(Geometry=[sdiff, sdiff_2], Material=ColourSwatch(SwatchColor=RGBA(0, 34, 255, 64)))
